# Grasshopper definition 平均頭の計測.gh (Grasshopper 1.0.7)
# plug-ins: Human UI, Telepathy, MetaHopper, Pancake, Pufferfish

pt = Point("{1,0,0}")
pt_2 = Point("{0,0,0}")
ln = Line(StartPoint=pt_2, EndPoint=pt)
number_slider = Slider(100, range=0..100)
number_slider_2 = Slider(100, range=0..100)
number_slider_3 = Slider(150, range=0..500)
mesh = Mesh(<mesh referenced from the Rhino model>)
front = Slider(0.62, range=0..1)
左 = Slider(0, range=-200..200)
右 = Slider(0, range=-200..200)

# ---- group: 瞳孔間幅
左_2 = Slider(-27, range=-200..200)
右_2 = Slider(-77, range=-200..200)
slider = CreateSlider(Slider=左_2, ShowBounds=False, ShowTicks=False, ShowTooltip=False, ShowValLabel=True, showLabel=True)
slider_2 = CreateSlider(Slider=右_2, ShowBounds=False, ShowTicks=False, ShowTooltip=False, ShowValLabel=True, showLabel=True)
merge = Merge(Data1=slider_2, Data2=slider)  # -> flatten(Result)
values = ValueListener(Elements=merge, SomeProperty=True)  # -> flatten(Values), Indices

# ----
rotate = Slider(0.5, range=0..1)

# ---- group: 形態学顔高
上部 = Slider(-98, range=-200..200)
下部 = Slider(-68, range=-200..200)
slider_3 = CreateSlider(Slider=上部, ShowBounds=False, ShowTicks=False, ShowTooltip=False, ShowValLabel=True, showLabel=True)
slider_4 = CreateSlider(Slider=下部, ShowBounds=False, ShowTicks=False, ShowTooltip=False, ShowValLabel=True, showLabel=True)
merge_2 = Merge(Data1=slider_3, Data2=slider_4)

# ----
B = Slider(4, range=0..100)

# ---- group: 全頭高
上部_2 = Slider(-24, range=-200..200)
下部_2 = Slider(-65, range=-200..200)
slider_5 = CreateSlider(Slider=上部_2, ShowBounds=False, ShowTicks=False, ShowTooltip=False, ShowValLabel=True, showLabel=True)
slider_6 = CreateSlider(Slider=下部_2, ShowBounds=False, ShowTicks=False, ShowTooltip=False, ShowValLabel=True, showLabel=True)
merge_3 = Merge(Data1=slider_5, Data2=slider_6)

# ---- group: 頭長
上部_3 = Slider(0, range=-200..200)
下部_3 = Slider(0, range=-200..200)
slider_7 = CreateSlider(Slider=上部_3, ShowBounds=False, ShowTicks=False, ShowTooltip=False, ShowValLabel=True, showLabel=True)
slider_8 = CreateSlider(Slider=下部_3, ShowBounds=False, ShowTicks=False, ShowTooltip=False, ShowValLabel=True, showLabel=True)
merge_4 = Merge(Data1=slider_7, Data2=slider_8)

# ---- group: 鼻高
上部_4 = Slider(-99, range=-200..200)
下部_4 = Slider(-17, range=-200..200)
slider_9 = CreateSlider(Slider=上部_4, ShowBounds=False, ShowTicks=False, ShowTooltip=False, ShowValLabel=True, showLabel=True)
slider_10 = CreateSlider(Slider=下部_4, ShowBounds=False, ShowTicks=False, ShowTooltip=False, ShowValLabel=True, showLabel=True)
merge_5 = Merge(Data1=slider_9, Data2=slider_10)

# ----
上部_5 = Slider(-118, range=-200..200)
下部_5 = Slider(-71, range=-200..200)
slider_11 = CreateSlider(Slider=下部_5, ShowBounds=False, ShowTicks=False, ShowTooltip=False, ShowValLabel=True, showLabel=True)
slider_12 = CreateSlider(Slider=上部_5, ShowBounds=False, ShowTicks=False, ShowTooltip=False, ShowValLabel=True, showLabel=True)
merge_6 = Merge(Data1=slider_12, Data2=slider_11)
values_2 = ValueListener(Elements=merge_6, SomeProperty=True)  # -> flatten(Values), Indices
鼻下_オトガイ距離 = RemoteSender(values_2.Values)

# ----
# 処理
panel = Panel("入力のリスト")
xz = XZPlane(Origin=Point(0, 0, 0))
neg = Negative(Value=number_slider)
rotax = RotateAxis(Geometry=mesh, Angle=degrees("90"), Axis=ln)  # -> Geometry, Transform
mesh_2 = RemoteSender(rotax.Geometry)
neg_2 = Negative(Value=number_slider_3)
neg_3 = Negative(Value=number_slider_2)
number_slider_4 = Slider(10, range=0..10)
dom = ConstructDomain(DomainStart=neg, DomainEnd=number_slider)
dom_2 = ConstructDomain(DomainStart=neg_2, DomainEnd=number_slider_3)
xy = XYPlane(Origin=Point(0, 0, 0))
slider_13 = CreateSlider(Slider=左, ShowBounds=False, ShowTicks=False, ShowTooltip=False, ShowValLabel=True, showLabel=True)
Y = UnitY(Factor=Slider(100, range=0..100))
dom_3 = ConstructDomain(DomainStart=neg_3, DomainEnd=number_slider_2)
yz = YZPlane(Origin=Point(0, 0, 0))
slider_14 = CreateSlider(Slider=右, ShowBounds=False, ShowTicks=False, ShowTooltip=False, ShowValLabel=True, showLabel=True)
planesrf = PlaneSurface(Plane=xz, XSize=dom, YSize=dom)
slider_15 = CreateSlider(Slider=front, ShowBounds=False, ShowTicks=False, ShowTooltip=False, ShowValLabel=True, showLabel=True)
slider_16 = CreateSlider(Slider=rotate, ShowBounds=False, ShowTicks=False, ShowTooltip=False, ShowValLabel=True, showLabel=True)

# ---- group: 頭囲
back = Slider(0.5, range=0..1)
slider_17 = CreateSlider(Slider=back, ShowBounds=False, ShowTicks=False, ShowTooltip=False, ShowValLabel=True, showLabel=True)
merge_7 = Merge(Data2=slider_15, Data3=slider_17, Data4=slider_16)

# ----
planesrf_2 = PlaneSurface(Plane=xy, XSize=dom_2, YSize=dom_2)
merge_8 = Merge(Data1=slider_14, Data2=slider_13)  # -> flatten(Result)
planesrf_3 = PlaneSurface(Plane=yz, XSize=dom_3, YSize=dom_3)
move = Move(Geometry=planesrf, Motion=Y)  # -> Geometry, Transform
values_3 = ValueListener(Elements=merge_5, SomeProperty=True)  # -> flatten(Values), Indices
panel_2 = Panel("""後頭・鼻尖距離
全頭高
瞳孔間幅
頭囲
頭長
頭幅
頬弓幅
下顎角幅
耳珠間幅
乳様突起間幅
内眼角幅
外眼角幅
口裂幅
形態学顔高
鼻高
鼻下・オトガイ距離""")
front_2 = Slider(0.68, range=0..1)
back_2 = Slider(0.47, range=0..1)
values_4 = ValueListener(Elements=merge_7, SomeProperty=True)  # -> flatten(Values), Indices
values_5 = ValueListener(Elements=merge_8, SomeProperty=True)  # -> flatten(Values), Indices
number_slider_5 = Slider(52, range=0..100)
X = UnitX(Factor=Slider(100, range=0..100))
鼻下_オトガイ距離_2 = RemoteReceiver(鼻下_オトガイ距離)
Z = UnitZ(Factor=Slider(100, range=0..100))
values_6 = ValueListener(Elements=merge_2, SomeProperty=True)  # -> flatten(Values), Indices
鼻高 = RemoteSender(values_3.Values)
values_7 = ValueListener(Elements=merge_4, SomeProperty=True)  # -> flatten(Values), Indices
srf = Surface(move.Geometry)
srf_2 = Surface(planesrf)
values_8 = ValueListener(Elements=merge_3, SomeProperty=True)  # -> flatten(Values), Indices
頭囲 = RemoteSender(values_4.Values)
頭囲_2 = RemoteReceiver(頭囲)
データ名 = RemoteSender(panel_2)
rotate_2 = Slider(0.5, range=0..1)
X_2 = UnitX(Factor=Slider(0, range=0..100))
values_9 = ValueListener(SomeProperty=True)  # -> Values, Indices
瞳孔間幅 = RemoteSender(values.Values)
move_2 = Move(Geometry=planesrf_3, Motion=X)  # -> Geometry, Transform
move_3 = Move(Geometry=planesrf_2, Motion=Z)  # -> Geometry, Transform
形態学顔高 = RemoteSender(values_6.Values)
形態学顔高_2 = RemoteReceiver(形態学顔高)
number_slider_6 = Slider(180, range=0..1000)
頭長 = RemoteSender(values_7.Values)
merge_9 = Merge(Data1=srf, Data2=srf_2)

# ---- group: 下顎角幅
左_3 = Slider(-50, range=-200..200)
右_3 = Slider(-55, range=-200..200)
slider_18 = CreateSlider(Slider=左_3, ShowBounds=False, ShowTicks=False, ShowTooltip=False, ShowValLabel=True, showLabel=True)
slider_19 = CreateSlider(Slider=右_3, ShowBounds=False, ShowTicks=False, ShowTooltip=False, ShowValLabel=True, showLabel=True)
merge_10 = Merge(Data1=slider_19, Data2=slider_18)  # -> flatten(Result)
values_10 = ValueListener(Elements=merge_10, SomeProperty=True)  # -> flatten(Values), Indices

# ---- group: 耳珠間幅
左_4 = Slider(-50, range=-200..200)
右_4 = Slider(-50, range=-200..200)
slider_20 = CreateSlider(Slider=左_4, ShowBounds=False, ShowTicks=False, ShowTooltip=False, ShowValLabel=True, showLabel=True)
slider_21 = CreateSlider(Slider=右_4, ShowBounds=False, ShowTicks=False, ShowTooltip=False, ShowValLabel=True, showLabel=True)
merge_11 = Merge(Data1=slider_21, Data2=slider_20)  # -> flatten(Result)
values_11 = ValueListener(Elements=merge_11, SomeProperty=True)  # -> flatten(Values), Indices

# ---- group: 乳様突起角幅
左_5 = Slider(-50, range=-200..200)
右_5 = Slider(-51, range=-200..200)
slider_22 = CreateSlider(Slider=右_5, ShowBounds=False, ShowTicks=False, ShowTooltip=False, ShowValLabel=True, showLabel=True)
slider_23 = CreateSlider(Slider=左_5, ShowBounds=False, ShowTicks=False, ShowTooltip=False, ShowValLabel=True, showLabel=True)
merge_12 = Merge(Data1=slider_23, Data2=slider_22)  # -> flatten(Result)
values_12 = ValueListener(Elements=merge_12, SomeProperty=True)  # -> flatten(Values), Indices

# ---- group: 頬弓幅
左_6 = Slider(-50, range=-200..200)
右_6 = Slider(-43, range=-200..200)
slider_24 = CreateSlider(Slider=左_6, ShowBounds=False, ShowTicks=False, ShowTooltip=False, ShowValLabel=True, showLabel=True)
slider_25 = CreateSlider(Slider=右_6, ShowBounds=False, ShowTicks=False, ShowTooltip=False, ShowValLabel=True, showLabel=True)
merge_13 = Merge(Data1=slider_25, Data2=slider_24)  # -> flatten(Result)
values_13 = ValueListener(Elements=merge_13, SomeProperty=True)  # -> flatten(Values), Indices

# ---- group: 頭幅
左_7 = Slider(-55, range=-200..200)
右_7 = Slider(-45, range=-200..200)
slider_26 = CreateSlider(Slider=左_7, ShowBounds=False, ShowTicks=False, ShowTooltip=False, ShowValLabel=True, showLabel=True)
slider_27 = CreateSlider(Slider=右_7, ShowBounds=False, ShowTicks=False, ShowTooltip=False, ShowValLabel=True, showLabel=True)
merge_14 = Merge(Data1=slider_27, Data2=slider_26)  # -> flatten(Result)
values_14 = ValueListener(Elements=merge_14, SomeProperty=True)  # -> flatten(Values), Indices

# ---- group: 内眼角幅
左_8 = Slider(-14, range=-200..200)
右_8 = Slider(-91, range=-200..200)
slider_28 = CreateSlider(Slider=左_8, ShowBounds=False, ShowTicks=False, ShowTooltip=False, ShowValLabel=True, showLabel=True)
slider_29 = CreateSlider(Slider=右_8, ShowBounds=False, ShowTicks=False, ShowTooltip=False, ShowValLabel=True, showLabel=True)
merge_15 = Merge(Data1=slider_29, Data2=slider_28)  # -> flatten(Result)
values_15 = ValueListener(Elements=merge_15, SomeProperty=True)  # -> flatten(Values), Indices

# ----
move_4 = Move(Motion=Vector(0, 0, 10))  # -> Geometry, Transform
slider_30 = CreateSlider(Slider=front_2, ShowBounds=False, ShowTicks=False, ShowTooltip=False, ShowValLabel=True, showLabel=True)
slider_31 = CreateSlider(Slider=back_2, ShowBounds=False, ShowTicks=False, ShowTooltip=False, ShowValLabel=True, showLabel=True)
全頭高 = RemoteSender(values_8.Values)
全頭高_2 = RemoteReceiver(全頭高)

# ---- group: 口裂幅
左_9 = Slider(-21, range=-200..200)
右_9 = Slider(-82, range=-200..200)
slider_32 = CreateSlider(Slider=左_9, ShowBounds=False, ShowTicks=False, ShowTooltip=False, ShowValLabel=True, showLabel=True)
slider_33 = CreateSlider(Slider=右_9, ShowBounds=False, ShowTicks=False, ShowTooltip=False, ShowValLabel=True, showLabel=True)
merge_16 = Merge(Data1=slider_33, Data2=slider_32)  # -> flatten(Result)
values_16 = ValueListener(Elements=merge_16, SomeProperty=True)  # -> flatten(Values), Indices

# ----
Z_2 = UnitZ(Factor=頭囲_2)

# ----
# 下部
srf_3 = Surface(planesrf_2)

# ----
# 上部
srf_4 = Surface(move_3.Geometry)

# ---- group: 外眼角幅
左_10 = Slider(-42, range=-200..200)
右_10 = Slider(-66, range=-200..200)
slider_34 = CreateSlider(Slider=左_10, ShowBounds=False, ShowTicks=False, ShowTooltip=False, ShowValLabel=True, showLabel=True)
slider_35 = CreateSlider(Slider=右_10, ShowBounds=False, ShowTicks=False, ShowTooltip=False, ShowValLabel=True, showLabel=True)
merge_17 = Merge(Data1=slider_35, Data2=slider_34)  # -> flatten(Result)
values_17 = ValueListener(Elements=merge_17, SomeProperty=True)  # -> flatten(Values), Indices

# ---- group: 右
srf_5 = Surface(move_2.Geometry)

# ---- group: 左
srf_6 = Surface(planesrf_3)

# ----
panel_3 = Panel("""平均的な頭のプロジェクト
後頭・鼻尖距離
全頭高
瞳孔間隔
頭囲
頭幅
頬骨幅
下顎角幅
耳珠間幅
乳様突起間幅
内眼角幅
外眼角幅
口裂幅
形態学顔高
鼻高
鼻下・オトガイ距離""")
multiplication = Multiplication(A=number_slider_4)
頭長_2 = RemoteReceiver(頭長)
neg_4 = Negative(Value=number_slider_6)
neg_5 = Negative(Value=X_2)
merge_18 = Merge(Data1=slider_30, Data2=slider_31)
slider_36 = CreateSlider(Slider=rotate_2, ShowBounds=False, ShowTicks=False, ShowTooltip=False, ShowValLabel=True, showLabel=True)
merge_19 = Merge(Data1=srf_5, Data2=srf_6)

X_3 = UnitX(Factor=1)
move_5 = Move(Geometry=merge_19, Motion=X_3)  # -> Geometry, Transform
area = Area(Geometry=move_5.Geometry)  # -> Area, Centroid
pdecon = Deconstruct(Point=area.Centroid)  # -> XComponent, YComponent, ZComponent
item = ListItem(List=pdecon.XComponent, Index=0, Wrap=True)  # -> Item, Item1
subtraction = Subtraction(A=item.Item, B=item.Item1)
panel_4 = Panel(subtraction)

neg_6 = Negative(Value=Z_2)
merge_20 = Merge(Data1=srf_4, Data2=srf_3)

鼻高_2 = RemoteReceiver(鼻高)
Z_3 = UnitZ(Factor=鼻高_2)
move_6 = Move(Geometry=merge_20, Motion=Z_3)  # -> Geometry, Transform
area_2 = Area(Geometry=move_6.Geometry)  # -> Area, Centroid
pdecon_2 = Deconstruct(Point=area_2.Centroid)  # -> XComponent, YComponent, ZComponent
item_2 = ListItem(List=pdecon_2.ZComponent, Index=0, Wrap=True)  # -> Item, Item1
subtraction_2 = Subtraction(A=item_2.Item, B=item_2.Item1)
panel_5 = Panel(subtraction_2)

values_18 = ValueListener(Elements=slider_16, SomeProperty=True)  # -> Values, Indices
label = CreateLabel(LabelText="頭囲", LabelSize="20", Justification=0)
move_7 = Move(Geometry=move_3.Geometry, Motion=neg_6)  # -> Geometry, Transform

X_4 = UnitX(Factor=1)
move_8 = Move(Geometry=merge_19, Motion=X_4)  # -> Geometry, Transform
area_3 = Area(Geometry=move_8.Geometry)  # -> Area, Centroid
pdecon_3 = Deconstruct(Point=area_3.Centroid)  # -> XComponent, YComponent, ZComponent
item_3 = ListItem(List=pdecon_3.XComponent, Index=0, Wrap=True)  # -> Item, Item1
subtraction_3 = Subtraction(A=item_3.Item, B=item_3.Item1)
panel_6 = Panel(subtraction_3)

Z_4 = UnitZ(Factor=全頭高_2)
dom_4 = ConstructDomain(DomainStart=neg_4, DomainEnd=number_slider_6)
Z_5 = UnitZ(Factor=形態学顔高_2)
Y_2 = UnitY(Factor=頭長_2)
label_2 = CreateLabel(LabelText=panel_3, LabelSize=12, Justification=0)
Z_6 = UnitZ(Factor=鼻下_オトガイ距離_2)
panel_7 = Panel(全頭高_2)
remap = RemapNumbers(Value=values_18.Values, Source=Domain(0, 1), Target=dom_4)  # -> Mapped, Clipped
move_9 = Move(Geometry=merge_20, Motion=Z_5)  # -> Geometry, Transform
形態学顔高surface = RemoteSender(move_9.Geometry)
move_10 = Move(Geometry=merge_20, Motion=Z_4)  # -> Geometry, Transform
move_11 = Move(Geometry=merge_20, Motion=Z_6)  # -> Geometry, Transform
move_12 = Move(Geometry=merge_9, Motion=Y_2)  # -> Geometry, Transform
concat = Concatenate(FragmentA="頭囲", FragmentB=" :")
addelems = AddElements(DoVLChecking=True)  # -> AddedElements, ElementNames
area_4 = Area(Geometry=move_9.Geometry)  # -> Area, Centroid
鼻高surface = RemoteSender(move_6.Geometry)
area_5 = Area(Geometry=move_10.Geometry)  # -> Area, Centroid
area_6 = Area(Geometry=move_11.Geometry)  # -> Area, Centroid
rad = Radians(Degrees=remap.Mapped)
鼻下_オトガイ距離surface = RemoteSender(move_11.Geometry)
item_4 = ListItem(List=label_2, Index=0, Wrap=True)  # -> Item, Item1, Item2, Item3, Item4, Item5, Item6, Item7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
頬弓幅 = RemoteSender(values_13.Values)

頬弓幅_2 = RemoteReceiver(頬弓幅)
X_5 = UnitX(Factor=頬弓幅_2)
move_13 = Move(Geometry=merge_19, Motion=X_5)  # -> Geometry, Transform
area_7 = Area(Geometry=move_13.Geometry)  # -> Area, Centroid
pdecon_4 = Deconstruct(Point=area_7.Centroid)  # -> XComponent, YComponent, ZComponent
item_5 = ListItem(List=pdecon_4.XComponent, Index=0, Wrap=True)  # -> Item, Item1
subtraction_4 = Subtraction(A=item_5.Item, B=item_5.Item1)
panel_8 = Panel(subtraction_4)

頬骨幅surface = RemoteSender(move_13.Geometry)
area_8 = Area(Geometry=move_12.Geometry)  # -> Area, Centroid
耳珠間幅 = RemoteSender(values_11.Values)

耳珠間幅_2 = RemoteReceiver(耳珠間幅)
X_6 = UnitX(Factor=耳珠間幅_2)
move_14 = Move(Geometry=merge_19, Motion=X_6)  # -> Geometry, Transform
area_9 = Area(Geometry=move_14.Geometry)  # -> Area, Centroid
pdecon_5 = Deconstruct(Point=area_9.Centroid)  # -> XComponent, YComponent, ZComponent
item_6 = ListItem(List=pdecon_5.XComponent, Index=0, Wrap=True)  # -> Item, Item1
subtraction_5 = Subtraction(A=item_6.Item, B=item_6.Item1)
panel_9 = Panel(subtraction_5)

耳珠間幅surface = RemoteSender(move_14.Geometry)
乳様突起間幅 = RemoteSender(values_12.Values)

乳様突起間幅_2 = RemoteReceiver(乳様突起間幅)
X_7 = UnitX(Factor=乳様突起間幅_2)
move_15 = Move(Geometry=merge_19, Motion=X_7)  # -> Geometry, Transform
area_10 = Area(Geometry=move_15.Geometry)  # -> Area, Centroid
pdecon_6 = Deconstruct(Point=area_10.Centroid)  # -> XComponent, YComponent, ZComponent
item_7 = ListItem(List=pdecon_6.XComponent, Index=0, Wrap=True)  # -> Item, Item1
subtraction_6 = Subtraction(A=item_7.Item, B=item_7.Item1)
panel_10 = Panel(subtraction_6)

乳様突起間幅surface = RemoteSender(move_15.Geometry)
内眼角幅 = RemoteSender(values_15.Values)

内眼角幅_2 = RemoteReceiver(内眼角幅)
X_8 = UnitX(Factor=内眼角幅_2)
move_16 = Move(Geometry=merge_19, Motion=X_8)  # -> Geometry, Transform
area_11 = Area(Geometry=move_16.Geometry)  # -> Area, Centroid
pdecon_7 = Deconstruct(Point=area_11.Centroid)  # -> XComponent, YComponent, ZComponent
item_8 = ListItem(List=pdecon_7.XComponent, Index=0, Wrap=True)  # -> Item, Item1
subtraction_7 = Subtraction(A=item_8.Item, B=item_8.Item1)
panel_11 = Panel(subtraction_7)

内眼角幅surface = RemoteSender(move_16.Geometry)
下顎角幅 = RemoteSender(values_10.Values)

下顎角幅_2 = RemoteReceiver(下顎角幅)
X_9 = UnitX(Factor=下顎角幅_2)
move_17 = Move(Geometry=merge_19, Motion=X_9)  # -> Geometry, Transform
area_12 = Area(Geometry=move_17.Geometry)  # -> Area, Centroid
pdecon_8 = Deconstruct(Point=area_12.Centroid)  # -> XComponent, YComponent, ZComponent
item_9 = ListItem(List=pdecon_8.XComponent, Index=0, Wrap=True)  # -> Item, Item1
subtraction_8 = Subtraction(A=item_9.Item, B=item_9.Item1)
panel_12 = Panel(subtraction_8)

下顎角幅surface = RemoteSender(move_17.Geometry)
pdecon_9 = Deconstruct(Point=area_4.Centroid)  # -> XComponent, YComponent, ZComponent
values_19 = ValueListener(Elements=merge_7, SomeProperty=True)  # -> Values, Indices
pdecon_10 = Deconstruct(Point=area_6.Centroid)  # -> XComponent, YComponent, ZComponent
pdecon_11 = Deconstruct(Point=area_5.Centroid)  # -> XComponent, YComponent, ZComponent
頭幅 = RemoteSender(values_14.Values)

頭幅_2 = RemoteReceiver(頭幅)
X_10 = UnitX(Factor=頭幅_2)
move_18 = Move(Geometry=merge_19, Motion=X_10)  # -> Geometry, Transform
area_13 = Area(Geometry=move_18.Geometry)  # -> Area, Centroid
pdecon_12 = Deconstruct(Point=area_13.Centroid)  # -> XComponent, YComponent, ZComponent
item_10 = ListItem(List=pdecon_12.XComponent, Index=0, Wrap=True)  # -> Item, Item1
subtraction_9 = Subtraction(A=item_10.Item, B=item_10.Item1)
panel_13 = Panel(subtraction_9)

頭幅surface = RemoteSender(move_18.Geometry)
口裂幅 = RemoteSender(values_16.Values)

口裂幅_2 = RemoteReceiver(口裂幅)
X_11 = UnitX(Factor=口裂幅_2)
move_19 = Move(Geometry=merge_19, Motion=X_11)  # -> Geometry, Transform
area_14 = Area(Geometry=move_19.Geometry)  # -> Area, Centroid
pdecon_13 = Deconstruct(Point=area_14.Centroid)  # -> XComponent, YComponent, ZComponent
item_11 = ListItem(List=pdecon_13.XComponent, Index=0, Wrap=True)  # -> Item, Item1
subtraction_10 = Subtraction(A=item_11.Item, B=item_11.Item1)
panel_14 = Panel(subtraction_10)

口裂幅surface = RemoteSender(move_19.Geometry)
全頭高surface = RemoteSender(move_10.Geometry)
pdecon_14 = Deconstruct(Point=area_8.Centroid)  # -> XComponent, YComponent, ZComponent
外眼角幅 = RemoteSender(values_17.Values)

外眼角幅_2 = RemoteReceiver(外眼角幅)
X_12 = UnitX(Factor=外眼角幅_2)
move_20 = Move(Geometry=merge_19, Motion=X_12)  # -> Geometry, Transform
area_15 = Area(Geometry=move_20.Geometry)  # -> Area, Centroid
pdecon_15 = Deconstruct(Point=area_15.Centroid)  # -> XComponent, YComponent, ZComponent
item_12 = ListItem(List=pdecon_15.XComponent, Index=0, Wrap=True)  # -> Item, Item1
subtraction_11 = Subtraction(A=item_12.Item, B=item_12.Item1)
panel_15 = Panel(subtraction_11)

外眼角幅surface = RemoteSender(move_20.Geometry)
number_slider_7 = Slider(10, range=0..10)
Y_3 = UnitY(Factor=1)
launchwin = LaunchWindow(
    Show=Toggle(True),
    Name="Control Window",
    Width=Slider(300, range=0..1000),
    Height=Slider(800, range=0..1000),
    ChildStatus=0,
    EnableHorizScroll=False)
number_slider_8 = Slider(4, range=0..100)
item_13 = ListItem(List=pdecon_9.ZComponent, Index=0, Wrap=True)  # -> Item, Item1
item_14 = ListItem(List=pdecon_10.ZComponent, Index=0, Wrap=True)  # -> Item, Item1
item_15 = ListItem(List=pdecon_11.ZComponent, Index=0, Wrap=True)  # -> Item, Item1
item_16 = ListItem(List=pdecon_14.YComponent, Index=0, Wrap=True)  # -> Item, Item1
subtraction_12 = Subtraction(A=item_13.Item, B=item_13.Item1)
subtraction_13 = Subtraction(A=item_14.Item, B=item_14.Item1)
subtraction_14 = Subtraction(A=item_15.Item, B=item_15.Item1)
panel_16 = Panel("""preview
preview
preview
preview
preview
preview
preview
preview
preview
preview
preview
preview
preview
preview""")
subtraction_15 = Subtraction(A=item_16.Item, B=item_16.Item1)
panel_17 = Panel(subtraction_12)
panel_18 = Panel(subtraction_14)
panel_19 = Panel(subtraction_13)
panel_20 = Panel(subtraction_15)
checkbox = CreateCheckbox(Label=panel_16, StartingValue=False)
number_slider_9 = Slider(180, range=0..1000)
multiplication_2 = Multiplication(A=number_slider_7, B=2)
item_17 = ListItem(List=checkbox, Index=0, Wrap=True)  # -> flatten(Item), flatten(Item1), flatten(Item2), flatten(Item3), flatten(Item4), flatten(Item5), flatten(Item6), flatten(Item7)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
merge_21 = Merge(
    Data1=item_4.Item,
    Data2=item_4.Item1,
    Data3=item_17.Item,
    Data4=item_4.Item2,
    Data5=merge_3,
    Data6=item_17.Item1,
    Data7=item_4.Item3,
    Data8=merge,
    Data9=item_17.Item2,
    Data10=item_4.Item4,
    Data11=merge_7,
    Data12=item_17.Item3,
    Data13=item_4.Item5,
    Data14=merge_14,
    Data15=item_17.Item4,
    Data16=item_4.Item6,
    Data17=merge_13,
    Data18=item_17.Item5,
    Data19=item_4.Item7,
    Data20=merge_10,
    Data21=item_17.Item6,
    Data22=item_4.Item8,
    Data23=merge_11,
    Data24=item_17.Item7,
    Data25=item_4.Item9,
    Data26=merge_12,
    Data27=item_17.Item8,
    Data28=item_4.Item10,
    Data29=merge_15,
    Data30=item_17.Item9,
    Data31=item_4.Item11,
    Data32=merge_17,
    Data33=item_17.Item10,
    Data34=item_4.Item12,
    Data35=merge_16,
    Data36=item_17.Item11,
    Data37=item_4.Item13,
    Data38=merge_2,
    Data39=item_17.Item12,
    Data40=item_4.Item14,
    Data41=merge_5,
    Data42=item_17.Item13,
    Data43=item_4.Item15,
    Data44=merge_6)
addelems_2 = AddElements(Window=launchwin, Elements=merge_21, DoVLChecking=True)  # -> AddedElements, ElementNames
label_3 = CreateLabel(LabelText=panel_17, LabelSize=12, Justification=0)
winprops = SetWindowProperties(Window=launchwin, StartingLocation="300,0", ShowTitleBar=True, ScaleFactor=1)
label_4 = CreateLabel(LabelText=panel_5, LabelSize=12, Justification=0)
label_5 = CreateLabel(LabelText=panel_20, LabelSize=12, Justification=0)
label_6 = CreateLabel(LabelText=panel_8, LabelSize=12, Justification=0)
label_7 = CreateLabel(LabelText=panel_19, LabelSize=12, Justification=0)
label_8 = CreateLabel(LabelText=panel_12, LabelSize=12, Justification=0)
label_9 = CreateLabel(LabelText=panel_6, LabelSize=12, Justification=0)
label_10 = CreateLabel(LabelText=panel_13, LabelSize=12, Justification=0)
label_11 = CreateLabel(LabelText=panel_14, LabelSize=12, Justification=0)
label_12 = CreateLabel(LabelText=panel_15, LabelSize=12, Justification=0)
label_13 = CreateLabel(LabelText=panel_11, LabelSize=12, Justification=0)
label_14 = CreateLabel(LabelText=panel_10, LabelSize=12, Justification=0)
label_15 = CreateLabel(LabelText=panel_4, LabelSize=12, Justification=0)
label_16 = CreateLabel(LabelText=panel_9, LabelSize=12, Justification=0)
values_20 = ValueListener(Elements=item_17.Item, SomeProperty=True)  # -> graft(Values), Indices
全頭高surface_2 = RemoteReceiver(全頭高surface)
頬骨幅surface_2 = RemoteReceiver(頬骨幅surface)
乳様突起間幅surface_2 = RemoteReceiver(乳様突起間幅surface)
neg_7 = Negative(Value=number_slider_9)
下顎角幅surface_2 = RemoteReceiver(下顎角幅surface)
values_21 = ValueListener(Elements=item_17.Item1, SomeProperty=True)  # -> graft(Values), Indices
values_22 = ValueListener(Elements=item_17.Item3, SomeProperty=True)  # -> graft(Values), Indices
内眼角幅surface_2 = RemoteReceiver(内眼角幅surface)
耳珠間幅surface_2 = RemoteReceiver(耳珠間幅surface)
頭幅surface_2 = RemoteReceiver(頭幅surface)
values_23 = ValueListener(Elements=item_17.Item2, SomeProperty=True)  # -> graft(Values), Indices
values_24 = ValueListener(Elements=item_17.Item5, SomeProperty=True)  # -> graft(Values), Indices
外眼角幅surface_2 = RemoteReceiver(外眼角幅surface)
形態学顔高surface_2 = RemoteReceiver(形態学顔高surface)
鼻下_オトガイ距離surface_2 = RemoteReceiver(鼻下_オトガイ距離surface)
values_25 = ValueListener(Elements=item_17.Item4, SomeProperty=True)  # -> graft(Values), Indices
values_26 = ValueListener(Elements=item_17.Item7, SomeProperty=True)  # -> graft(Values), Indices
values_27 = ValueListener(Elements=item_17.Item6, SomeProperty=True)  # -> graft(Values), Indices
口裂幅surface_2 = RemoteReceiver(口裂幅surface)
鼻高surface_2 = RemoteReceiver(鼻高surface)
values_28 = ValueListener(Elements=item_17.Item8, SomeProperty=True)  # -> graft(Values), Indices
values_29 = ValueListener(Elements=item_17.Item9, SomeProperty=True)  # -> graft(Values), Indices
values_30 = ValueListener(Elements=item_17.Item11, SomeProperty=True)  # -> graft(Values), Indices
values_31 = ValueListener(Elements=item_17.Item12, SomeProperty=True)  # -> graft(Values), Indices
values_32 = ValueListener(Elements=item_17.Item10, SomeProperty=True)  # -> graft(Values), Indices
number_slider_10 = Slider(10, range=0..10)
values_33 = ValueListener(Elements=item_17.Item13, SomeProperty=True)  # -> graft(Values), Indices
values_34 = ValueListener(Elements=slider_36, SomeProperty=True)  # -> Values, Indices
Y_4 = UnitY(Factor=1)
瞳孔間隔preview = RemoteSender(values_21.Values)
瞳孔間隔preview_2 = RemoteReceiver(瞳孔間隔preview)
onoff = EnableDisableObject(Enabled=瞳孔間隔preview_2, AllObjects_Object=[瞳孔間幅_2, X_14, move_21, sec, panel_28])
dom_5 = ConstructDomain(DomainStart=neg_7, DomainEnd=number_slider_9)
panel_21 = Panel(values_20.Values)
number_slider_11 = Slider(10, range=0..10)
yz_2 = YZPlane(Origin=Point(0, 0, 0))
remap_2 = RemapNumbers(Value=values_34.Values, Source=Domain(0, 1), Target=dom_5)  # -> Mapped, Clipped
panel_22 = Panel("""後頭・鼻尖距離
全頭高
瞳孔間隔
頭囲
頭長
頭幅
頬骨幅
下顎角幅
耳珠間幅
乳様突起間幅
内眼角幅
外眼角幅
口裂幅
形態学顔高
鼻高
鼻下・オトガイ距離""")
rad_2 = Radians(Degrees=remap_2.Mapped)
label_17 = CreateLabel(LabelText=panel_18, LabelSize=12, Justification=0)
button = CreateButton(ButtonName="保存", ButtonStyle=0)
filepicker = CreateFilePicker(ButtonLabelText="元データ選択", DialogType=0, MustExist=True, Filter="All Files|*.*")
swatch = ColourSwatch(SwatchColor=RGB(14, 193, 84))
filepicker_2 = CreateFilePicker(ButtonLabelText="フォルダー選択", DialogType="2", MustExist=True, Filter="All Files|*.*")
textbox = CreateTextBox(Label="ファイル名", UpdateButton=Toggle(False), showLabel=True)
label_18 = CreateLabel(LabelText=panel_22, LabelSize=12, Justification=0)
item_18 = ListItem(List=label_18, Index=0, Wrap=True)  # -> Item, Item1, Item2, Item3, Item4, Item5, Item6, Item7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
values_35 = ValueListener(Elements=filepicker, SomeProperty=True)  # -> Values, Indices
c_script = CSharpScript(fileName=values_35.Values, cure=Toggle(False))  # -> out, meshes, names; inputs fileName: String, cure: Boolean
# ---------- c_script: C# usings ----------
using System.IO;
using System.Windows.Forms;
# ---------- c_script: C# ----------
    //Laurent Delrieu
    //22/06/2019
    //https://discourse.mcneel.com/t/read-a-stl-in-grasshopper/85081/9
    List<Mesh> stlMeshes = new List<Mesh>();
    List<string> stlNames = new List<string>();
    string text = null;
    bool binary = true;
    if (File.Exists(fileName))
    {
      using (BinaryReader reader = new BinaryReader(File.Open(fileName, FileMode.Open)))
      {
        char [] header = System.Text.Encoding.ASCII.GetString(reader.ReadBytes(160)).ToCharArray();
        string headerString = new string(header);
        if (headerString != null && headerString.Contains("solid ") && headerString.Contains("outer") && headerString.Contains("loop"))
        {
          binary = false;
        }
        else
        {
          binary = true;
        }
      }//End Using
      if (binary)
      {
        stlMeshes.Add(ReadBinaryFile(fileName, out text));
        stlNames.Add(text);
      }
      else
      {

        stlMeshes = ReadAsciiFile(fileName, out stlNames);

      }
    }

    if (cure)
    {
      foreach(Mesh stlMesh in stlMeshes)
      {
        stlMesh.Vertices.CombineIdentical(true, true);
        stlMesh.Faces.CullDegenerateFaces();
        stlMesh.UnifyNormals();
        stlMesh.RebuildNormals();
        stlMesh.Compact();
      }
    }
    meshes = stlMeshes;
    names = stlNames;
# ---------- c_script: C# additional code ----------
  public List<Mesh> ReadAsciiFile(string fileName, out List<string> stlNames)
  {
    string text = "no name";
    List<Mesh> output = new List<Mesh>();
    stlNames = new List<string>();

    if (File.Exists(fileName))
    {
      using(StreamReader reader = new StreamReader(fileName))
      {
        Mesh stlMesh;
        do
        {
          stlMesh = ReadAsciiFile(reader, out text);
          if (stlMesh != null)
          {
            output.Add(stlMesh);
            stlNames.Add(text);
          }
        }
        while (stlMesh != null);
      }//End using
    }
    return output;
  }
  public Mesh ReadAsciiFile(StreamReader reader, out string text)
  {
    string line = "Pas de fichier";
    string[] split = {" "};
    int faces = 0;
    Mesh stlMesh = new Mesh();
    text = "no name";

    line = reader.ReadLine();
    if (line != null)
    {
      split = line.Split(new Char [] {' ' , '\t' , '\n'}, StringSplitOptions.RemoveEmptyEntries);
      if (split.Length > 1)
      {
        stlMesh.SetUserString("Name", split[split.Length - 1]);
        text = split[split.Length - 1];
      }
      line = reader.ReadLine();
      while (!line.Contains("endsolid") && !line.Contains("end solid"))
      {
        line = reader.ReadLine();
        if (line.Contains("vertex")) //Treat some case where there is no normal
        {
          split = line.Split(new Char [] {' ' , '\t' , '\n'}, StringSplitOptions.RemoveEmptyEntries);
          if (split.Length > 3)
          {
            stlMesh.Vertices.Add(double.Parse(split[1]), double.Parse(split[2]), double.Parse(split[3]));
          }
        }
        if (line.Contains("endfacet"))
        {
          faces += 1;
        }
      }//End while

      if (stlMesh.Vertices.Count == faces * 3)
      {
        for (int i = 0; i < faces; i++)
        {
          stlMesh.Faces.AddFace(i * 3, i * 3 + 1, i * 3 + 2);
        }
        if (stlMesh.FaceNormals.Count != stlMesh.Faces.Count)
        {
          stlMesh.RebuildNormals();
        }
        stlMesh.Normals.ComputeNormals();

      }
      else
      {
        stlMesh = null;
      }
    }
    else
    {
      stlMesh = null;
    }

    return stlMesh;
  }

  public Mesh ReadAsciiFileObsolete(string fileName, out string  headerText)
  {
    headerText = "Not possible to read this STL !!!";
    string line = "Pas de fichier";
    string[] split = {" "};
    int faces = 0;
    Mesh stlMesh = new Mesh();
    if (File.Exists(fileName))
    {
      using(StreamReader reader = new StreamReader(fileName))
      {
        headerText = reader.ReadLine();//Header
        line = reader.ReadLine();
        while (!line.Contains("endsolid") && !line.Contains("end solid"))
        {
          line = reader.ReadLine();
          if (line.Contains("vertex")) //Treat some case where there is no normal
          {
            split = line.Split(new Char [] {' ' , '\t' , '\n'}, StringSplitOptions.RemoveEmptyEntries);
            if (split.Length > 3)
            {
              stlMesh.Vertices.Add(double.Parse(split[1]), double.Parse(split[2]), double.Parse(split[3]));
            }
          }
          if (line.Contains("endfacet"))
          {
            faces += 1;
          }
        }//End while

        if (stlMesh.Vertices.Count == faces * 3)
        {
          for (int i = 0; i < faces; i++)
          {
            stlMesh.Faces.AddFace(i * 3, i * 3 + 1, i * 3 + 2);
          }
        }
        if (stlMesh.FaceNormals.Count != stlMesh.Faces.Count)
        {
          stlMesh.RebuildNormals();
        }
        stlMesh.Normals.ComputeNormals();
      }//End using
    }
    return stlMesh;
  }



  public Mesh ReadBinaryFile(string fileName, out string  headerText)
  {
    char[] header = null;
    int faces = 0;
    float nx, ny, nz, vx, vy,vz;
    Mesh mesh = new Mesh();
    if (File.Exists(fileName))
    {
      using (BinaryReader reader = new BinaryReader(File.Open(fileName, FileMode.Open)))
      {
        //BINARY STL
        /*
        UINT8[80] – Header
        UINT32 – Number of triangles


        foreach triangle
        REAL32[3] – Normal vector
        REAL32[3] – Vertex 1
        REAL32[3] – Vertex 2
        REAL32[3] – Vertex 3
        UINT16 – Attribute byte count
        end
        */

        header = reader.ReadChars(80);
        faces = reader.ReadInt32();
        //tempDirectory = reader.ReadString();
        //autoSaveTime = reader.ReadInt32();
        //showStatusBar = reader.ReadBoolean();

        for (int i = 0; i < faces; i++)
        {
          nx = reader.ReadSingle();
          ny = reader.ReadSingle();
          nz = reader.ReadSingle();

          mesh.FaceNormals.AddFaceNormal(nx, ny, nz);

          vx = reader.ReadSingle();
          vy = reader.ReadSingle();
          vz = reader.ReadSingle();
          mesh.Vertices.Add(vx, vy, vz);

          vx = reader.ReadSingle();
          vy = reader.ReadSingle();
          vz = reader.ReadSingle();
          mesh.Vertices.Add(vx, vy, vz);

          vx = reader.ReadSingle();
          vy = reader.ReadSingle();
          vz = reader.ReadSingle();
          mesh.Vertices.Add(vx, vy, vz);
          Int16 ii = reader.ReadInt16();

        }
        for (int i = 0; i < faces; i++)
        {
          mesh.Faces.AddFace(i * 3, i * 3 + 1, i * 3 + 2);
        }
      }
    }
    headerText = new string(header);
    mesh.Normals.ComputeNormals();
    return mesh;
  }
# ---------- end c_script ----------
rotax_2 = RotateAxis(Geometry=c_script.meshes, Angle=1.570796327, Axis=Line((0, 0, 0), (10, 0, 0)))  # -> Geometry, Transform
mesh_3 = Mesh(rotax_2.Geometry)
bbox = BoundingBox(Content=mesh_3, Plane=PlaneXY(0, 0, 0))  # -> Box, Box_2
merge_22 = Merge(Data1=rotax_2.Geometry)
null = NullItem(Item=mesh_3)  # -> NullFlags, InvalidFlags, Description
debox = DeconstructBox(Box=bbox.Box)  # -> Plane, X, Y, Z
or = GateOr(A=null.NullFlags, B=null.InvalidFlags)
dedomain = DeconstructDomain(Domain=debox.Z)  # -> Start, End
subtraction_16 = Subtraction(A=dedomain.End, B=dedomain.Start)
dedomain_2 = DeconstructDomain(Domain=debox.X)  # -> Start, End
dedomain_3 = DeconstructDomain(Domain=debox.Y)  # -> Start, End
dom_6 = ConstructDomain(DomainStart=0, DomainEnd=subtraction_16)
not = GateNot(A=or)
remap_3 = RemapNumbers(Value=values_4.Values, Source=Domain(0, 1), Target=dom_6)  # -> flatten(Mapped), Clipped
addition = Addition(A=dedomain_2.End, B=number_slider_7)
addition_2 = Addition(A=dedomain_3.End, B=number_slider_8)
addition_3 = Addition(A=dedomain.Start, B=remap_3.Mapped)
subtraction_17 = Subtraction(A=dedomain_3.End, B=dedomain_3.Start)
subtraction_18 = Subtraction(A=dedomain_3.Start, B=number_slider_8)
merge_23 = Merge(Data1=subtraction_18, Data2=addition_2)
pt_3 = ConstructPoint(XCoordinate=addition, YCoordinate=merge_23, ZCoordinate=addition_3)
bang = ExplodeTree(Data=simplify(graft(pt_3)))  # -> Branch0, Branch1, Branch2
subtraction_19 = Subtraction(A=dedomain_2.End, B=dedomain_2.Start)
ln_2 = Line(StartPoint=bang.Branch0, EndPoint=bang.Branch1)
addition_4 = Addition(A=subtraction_19, B=multiplication_2)
X_13 = UnitX(Factor=addition_4)
neg_8 = Negative(Value=X_13)
extr = Extrude(Base=ln_2, Direction=neg_8)
bbox_2 = BoundingBox(Content=extr, Plane=PlaneXY(0, 0, 0))  # -> Box, Box_2
volume = Volume(Geometry=bbox_2.Box)  # -> Volume, Centroid
line = LineSDL(Start=volume.Centroid, Direction=Y_4, Length=1)
rotax_3 = RotateAxis(Geometry=extr, Angle=rad_2, Axis=line)  # -> Geometry, Transform
mmx = MeshMesh(MeshA=mesh_3, MeshB=rotax_3.Geometry)
bbox_3 = BoundingBox(Content=mmx, Plane=PlaneXY(0, 0, 0))  # -> Box, Box_2
len = Length(Curve=mmx)
multiplication_3 = Multiplication(A=len, B=number_slider_11)
round = Round(Number=multiplication_3)  # -> Nearest, Floor, Ceiling
division = Division(A=round.Nearest, B=number_slider_11)
concat_2 = Concatenate(FragmentA=concat, FragmentB=division)
concat_3 = Concatenate(FragmentA=concat_2, FragmentB="mm")
setlabel = SetLabelContents(LabelToModify=label, NewLabelContents=concat_3)
debox_2 = DeconstructBox(Box=bbox_3.Box)  # -> Plane, X, Y, Z
dedomain_4 = DeconstructDomain(Domain=debox_2.Y)  # -> Start, End
dedomain_5 = DeconstructDomain(Domain=debox_2.Z)  # -> Start, End
values_36 = ValueListener(Elements=filepicker_2, SomeProperty=True)  # -> Values, Indices
values_37 = ValueListener(Elements=button, SomeProperty=True)  # -> Values, Indices
values_38 = ValueListener(Elements=textbox, SomeProperty=True)  # -> Values, Indices
launchwin_2 = LaunchWindow(Show=Toggle(True), Name="計測結果", Width=370, Height=Slider(800, range=0..1000), ChildStatus=0, EnableHorizScroll=False)
pt_4 = ConstructPoint(XCoordinate=0, YCoordinate=dedomain_4.Start, ZCoordinate=dedomain_5.Start)
pt_5 = ConstructPoint(XCoordinate=0, YCoordinate=dedomain_4.End, ZCoordinate=dedomain_5.End)
launchwin_3 = LaunchWindow(
    Show=Toggle(True),
    Name="ファイルインポート",
    Width=Slider(300, range=0..1000),
    Height=Slider(300, range=0..1000),
    ChildStatus=0,
    EnableHorizScroll=False)
winprops_2 = SetWindowProperties(Window=launchwin_3, StartingLocation="0,0", ShowTitleBar=True, ScaleFactor=1)
merge_24 = Merge(Data1=filepicker, Data2=filepicker_2, Data3=textbox, Data4=button)
頭囲surface = RemoteSender(rotax_3.Geometry)
頭囲surface_2 = RemoteReceiver(頭囲surface)
dist = Distance(PointA=pt_4, PointB=pt_5)
pcimportfrom = ImportFrom(File=values_35.Values, LastSaveLocalization="neutral,N")  # -> Geo, Layer, ObjectAttributes
panel_23 = Panel(dist)
panel_24 = Panel(panel_23)
graft = GraftTree(Tree=panel_24, IncludeEmptyLists=True, IncludeNullItems=True)  # -> flatten(Tree)
label_19 = CreateLabel(LabelText=flatten(panel_24), LabelSize=12, Justification=0)
addelems_3 = AddElements(Window=launchwin_3, Elements=flatten(merge_24), DoVLChecking=True)  # -> AddedElements, ElementNames
material = CreateMaterial(
    Diffuse=ColourSwatch(SwatchColor=RGB(72, 103, 255)),
    Specular=RGB(255, 255, 255),
    Emission=ColourSwatch(SwatchColor=RGB(231, 15, 255)),
    Transparency=0,
    Shine=0)
winprops_3 = SetWindowProperties(Window=launchwin_2, StartingLocation="1100,0", ShowTitleBar=True, ScaleFactor=1)
ghpython_script = GhPythonScript(x=values_35.Values)  # -> out, a
# ---------- ghpython_script: Python ----------
__author__ = "JapanMedicalCompany"
__version__ = "2020.11.06"

import rhinoscriptsyntax as rs

if x:
    a = True
else :
    a = False
# ---------- end ghpython_script ----------
データ名_2 = RemoteReceiver(データ名)
bbox_4 = BoundingBox(Content=pcimportfrom.Geo, Plane=PlaneXY(0, 0, 0))  # -> Box, Box_2
label_20 = CreateLabel(LabelText=データ名_2, LabelSize=12, Justification=0)
volume_2 = Volume(Geometry=bbox_4.Box)  # -> Volume, Centroid
onoff_2 = EnableDisableObject(Enabled=ghpython_script.a)
sort = SortList(Keys=volume_2.Volume, ValuesA=pcimportfrom.Geo)  # -> Keys, ValuesA
item_19 = ListItem(List=sort.ValuesA, Index=0, Wrap=True)
rotate_3 = Rotate(Geometry=item_19, Angle=degrees("90"), Plane=yz_2)  # -> Geometry, Transform
bbox_5 = BoundingBox(Content=rotate_3.Geometry, Plane=PlaneXY(0, 0, 0))  # -> Box, Box_2
volume_3 = Volume(Geometry=bbox_5.Box)  # -> Volume, Centroid
move2pt = MoveToPoint(Geometry=rotate_3.Geometry, PointA=volume_3.Centroid, PointB="0,0,0")  # -> Moved, Vector, Transform
mesh_4 = Mesh(move2pt.Moved)

# ---- group: 読み込んだ時に後頭・鼻尖距離
bbox_6 = BoundingBox(Content=mesh_4, Plane=PlaneXY(0, 0, 0))  # -> Box, Box_2

# ----
debox_3 = DeconstructBox(Box=bbox_6.Box)  # -> Plane, X, Y, Z
dedomain_6 = DeconstructDomain(Domain=debox_3.Y)  # -> Start, End
panel_25 = Panel(debox_3.Y)
subtraction_20 = Subtraction(A=dedomain_6.End, B=dedomain_6.Start)
panel_26 = Panel(dedomain_6.Start)
panel_27 = Panel(subtraction_20)
graft_2 = GraftTree(Tree=panel_27, IncludeEmptyLists=True, IncludeNullItems=True)  # -> flatten(Tree)
label_21 = CreateLabel(LabelText=flatten(panel_27), LabelSize=12, Justification=0)
geo = Geometry(mesh_4)
bbox_7 = BoundingBox(Content=geo, Plane=PlaneXY(0, 0, 0))  # -> Box, Box_2
debox_4 = DeconstructBox(Box=bbox_7.Box)  # -> Plane, X, Y, Z
dedomain_7 = DeconstructDomain(Domain=debox_4.Y)  # -> Start, End
dedomain_8 = DeconstructDomain(Domain=debox_4.X)  # -> Start, End
dedomain_9 = DeconstructDomain(Domain=debox_4.Z)  # -> Start, End
subtraction_21 = Subtraction(A=dedomain_9.Start, B=dedomain_9.End)
dom_7 = ConstructDomain(DomainStart=0, DomainEnd=subtraction_21)
subtraction_22 = Subtraction(A=dedomain_7.Start, B=B)
addition_5 = Addition(A=dedomain_7.End, B=B)
addition_6 = Addition(A=dedomain_8.End, B=number_slider_4)
remap_4 = RemapNumbers(Value=values_4.Values, Source=Domain(0, 1), Target=dom_7)  # -> flatten(Mapped), Clipped
addition_7 = Addition(A=dedomain_9.Start, B=remap_4.Mapped)
merge_25 = Merge(Data1=subtraction_22, Data2=addition_5)
pt_6 = ConstructPoint(XCoordinate=addition_6, YCoordinate=merge_25, ZCoordinate=addition_7)
bang_2 = ExplodeTree(Data=simplify(graft(pt_6)))  # -> Branch0, Branch1, Branch2
subtraction_23 = Subtraction(A=dedomain_8.End, B=dedomain_8.Start)
ln_3 = Line(StartPoint=bang_2.Branch0, EndPoint=bang_2.Branch1)
addition_8 = Addition(A=subtraction_23, B=multiplication)

瞳孔間幅_2 = RemoteReceiver(瞳孔間幅)  # disabled
X_14 = UnitX(Factor=瞳孔間幅_2)  # disabled
move_21 = Move(Geometry=move_2.Geometry, Motion=neg_5)  # -> Geometry, Transform; disabled
panel_28 = Panel(瞳孔間幅_2)  # disabled
sec = MeshPlane(Mesh=geo, Plane=move_21.Geometry)  # disabled

move_22 = Move(Geometry=merge_19, Motion=X_14)  # -> Geometry, Transform
瞳孔間幅surface = RemoteSender(move_22.Geometry)
X_15 = UnitX(Factor=addition_8)
sec_2 = MeshPlane(Mesh=geo, Plane=move_7.Geometry)
area_16 = Area(Geometry=move_22.Geometry)  # -> Area, Centroid

# ---- group: 頭長
bbox_8 = BoundingBox(Content=sec_2, Plane=PlaneXY(0, 0, 0))  # -> Box, Box_2

# ----
neg_9 = Negative(Value=X_15)
len_2 = Length(Curve=sec_2)
pdecon_16 = Deconstruct(Point=area_16.Centroid)  # -> XComponent, YComponent, ZComponent
debox_5 = DeconstructBox(Box=bbox_8.Box)  # -> Plane, X, Y, Z
dedomain_10 = DeconstructDomain(Domain=debox_5.Y)  # -> Start, End
panel_29 = Panel(len_2)
panel_30 = Panel(debox_5.Y)
item_20 = ListItem(List=pdecon_16.XComponent, Index=0, Wrap=True)  # -> Item, Item1
extr_2 = Extrude(Base=ln_3, Direction=neg_9)
bbox_9 = BoundingBox(Content=extr_2, Plane=PlaneXY(0, 0, 0))  # -> Box, Box_2
panel_31 = Panel(len_2)

# ---- group: 外眼角幅
merge_26 = Merge(Data1=geo, Data2=move_20.Geometry)  # -> flatten(Result)

# ----
volume_4 = Volume(Geometry=bbox_9.Box)  # -> Volume, Centroid
merge_27 = Merge(Data1=geo, Data2=move_22.Geometry)  # -> flatten(Result)
subtraction_24 = Subtraction(A=dedomain_10.End, B=dedomain_10.Start)
subtraction_25 = Subtraction(A=item_20.Item, B=item_20.Item1)
line_2 = LineSDL(Start=volume_4.Centroid, Direction=Y_3, Length=1)

# ---- group: 頭囲
merge_28 = Merge(Data1=rotax_3.Geometry, Data2=geo)  # -> flatten(Result)

# ----
scale = Scale(Geometry=merge_27, Center=Point(0, 0, 0), Factor="0.1")  # -> Geometry, Transform

# ---- group: 頭長
merge_29 = Merge(Data1=move_12.Geometry, Data2=geo)  # -> flatten(Result)

# ----
scale_2 = Scale(Geometry=merge_26, Center=Point(0, 0, 0), Factor="0.1")  # -> Geometry, Transform

# ---- group: 口裂幅
merge_30 = Merge(Data1=geo, Data2=move_19.Geometry)  # -> flatten(Result)

# ----
panel_32 = Panel(subtraction_25)

# ---- group: 頬弓幅
merge_31 = Merge(Data1=geo, Data2=move_13.Geometry)  # -> flatten(Result)

# ----
panel_33 = Panel(subtraction_24)
scale_3 = Scale(Geometry=merge_28, Center=Point(0, 0, 0), Factor="0.1")  # -> Geometry, Transform

# ---- group: 形態学顔高
merge_32 = Merge(Data1=move_9.Geometry, Data2=geo)  # -> flatten(Result)

# ----
rotax_4 = RotateAxis(Geometry=extr_2, Angle=rad, Axis=line_2)  # -> Geometry, Transform
scale_4 = Scale(Geometry=merge_29, Center=Point(0, 0, 0), Factor="0.1")  # -> Geometry, Transform

# ---- group: 頭幅
merge_33 = Merge(Data1=geo, Data2=move_18.Geometry)  # -> flatten(Result)

# ----
graft_3 = GraftTree(Tree=panel_31, IncludeEmptyLists=True, IncludeNullItems=True)  # -> flatten(Tree)

# ---- group: 下顎角幅
merge_34 = Merge(Data1=geo, Data2=move_17.Geometry)  # -> flatten(Result)

# ---- group: 全頭高
merge_35 = Merge(Data1=geo, Data2=move_10.Geometry)  # -> flatten(Result)

# ----
graft_4 = GraftTree(Tree=panel_33, IncludeEmptyLists=True, IncludeNullItems=True)  # -> flatten(Tree)
scale_5 = Scale(Geometry=merge_32, Center=Point(0, 0, 0), Factor="0.1")  # -> Geometry, Transform
label_22 = CreateLabel(LabelText=panel_32, LabelSize=12, Justification=0)
scale_6 = Scale(Geometry=merge_33, Center=Point(0, 0, 0), Factor="0.1")  # -> Geometry, Transform
scale_7 = Scale(Geometry=merge_34, Center=Point(0, 0, 0), Factor="0.1")  # -> Geometry, Transform
scale_8 = Scale(Geometry=merge_31, Center=Point(0, 0, 0), Factor="0.1")  # -> Geometry, Transform
瞳孔間幅surface_2 = RemoteReceiver(瞳孔間幅surface)
scale_9 = Scale(Geometry=merge_30, Center=Point(0, 0, 0), Factor="0.1")  # -> Geometry, Transform

# ---- group: 鼻下・オトガイ距離
merge_36 = Merge(Data1=move_11.Geometry, Data2=geo)  # -> flatten(Result)

# ---- group: 内眼角幅
merge_37 = Merge(Data1=geo, Data2=move_16.Geometry)  # -> flatten(Result)

# ---- group: 耳珠間幅
merge_38 = Merge(Data1=geo, Data2=move_14.Geometry)  # -> flatten(Result)

# ----
scale_10 = Scale(Geometry=merge_35, Center=Point(0, 0, 0), Factor="0.1")  # -> Geometry, Transform

# ---- group: 鼻高
merge_39 = Merge(Data1=move_6.Geometry, Data2=geo)  # -> flatten(Result)

# ----
len_3 = Length(Curve=rotax_4.Geometry)

# ---- group: 乳様突起間幅
merge_40 = Merge(Data1=geo, Data2=move_15.Geometry)  # -> flatten(Result)

# ----
scale_11 = Scale(Geometry=merge_37, Center=Point(0, 0, 0), Factor="0.1")  # -> Geometry, Transform
scale_12 = Scale(Geometry=merge_38, Center=Point(0, 0, 0), Factor="0.1")  # -> Geometry, Transform
scale_13 = Scale(Geometry=merge_39, Center=Point(0, 0, 0), Factor="0.1")  # -> Geometry, Transform
scale_14 = Scale(Geometry=merge_36, Center=Point(0, 0, 0), Factor="0.1")  # -> Geometry, Transform
scale_15 = Scale(Geometry=merge_40, Center=Point(0, 0, 0), Factor="0.1")  # -> Geometry, Transform
multiplication_4 = Multiplication(A=len_3, B=number_slider_10)
label_23 = CreateLabel(LabelText=panel_32, LabelSize=12, Justification=0)
round_2 = Round(Number=multiplication_4)  # -> Nearest, Floor, Ceiling
division_2 = Division(A=round_2.Nearest, B=number_slider_10)
panel_34 = Panel(division_2)
graft_5 = GraftTree(Tree=panel_34, IncludeEmptyLists=True, IncludeNullItems=True)  # -> flatten(Tree)
label_24 = CreateLabel(LabelText=flatten(panel_34), LabelSize=12, Justification=0)
merge_41 = Merge(
    Data1=graft(graft_2),
    Data2=graft(panel_18),
    Data3=graft(panel_32),
    Data4=graft(graft_5),
    Data5=graft(graft),
    Data6=graft(panel_13),
    Data7=graft(panel_8),
    Data8=graft(panel_12),
    Data9=graft(panel_9),
    Data10=graft(panel_10),
    Data11=graft(panel_11),
    Data12=graft(panel_15),
    Data13=graft(panel_14),
    Data14=graft(panel_17),
    Data15=graft(panel_5),
    Data16=graft(panel_19))  # -> flatten(Result)
merge_42 = Merge(
    Data1=item_18.Item,
    Data2=label_21,
    Data3=item_18.Item1,
    Data4=label_17,
    Data5=item_18.Item2,
    Data6=label_23,
    Data7=item_18.Item3,
    Data8=label_24,
    Data9=item_18.Item4,
    Data10=label_19,
    Data11=item_18.Item5,
    Data12=label_10,
    Data13=item_18.Item6,
    Data14=label_6,
    Data15=item_18.Item7,
    Data16=label_8,
    Data17=item_18.Item8,
    Data18=label_16,
    Data19=item_18.Item9,
    Data20=label_14,
    Data21=item_18.Item10,
    Data22=label_13,
    Data23=item_18.Item11,
    Data24=label_12,
    Data25=item_18.Item12,
    Data26=label_11,
    Data27=item_18.Item13,
    Data28=label_3,
    Data29=item_18.Item14,
    Data30=label_4,
    Data31=item_18.Item15,
    Data32=label_7)
panel_35 = Panel(merge_41)
preview = CustomPreview(Geometry=geo, Material=material)
entwine = Entwine(Branch00=merge_42, FlattenInputs=True)
addelems_4 = AddElements(Window=launchwin_2, Elements=flatten(entwine), DoVLChecking=True)  # -> AddedElements, ElementNames
distance = RemoteSender(panel_35)
headmesh = RemoteSender(geo)
headmesh_2 = RemoteReceiver(headmesh)
headmesh_3 = RemoteReceiver(headmesh)
headmesh_4 = RemoteReceiver(headmesh)
headmesh_5 = RemoteReceiver(headmesh)
headmesh_6 = RemoteReceiver(headmesh)
headmesh_7 = RemoteReceiver(headmesh)
headmesh_8 = RemoteReceiver(headmesh)
headmesh_9 = RemoteReceiver(headmesh)
headmesh_10 = RemoteReceiver(headmesh)
headmesh_11 = RemoteReceiver(headmesh)
headmesh_12 = RemoteReceiver(headmesh)
headmesh_13 = RemoteReceiver(headmesh)
headmesh_14 = RemoteReceiver(headmesh)
headmesh_15 = RemoteReceiver(headmesh)
python = GhPythonScript(preview=values_20.Values, headMesh=headmesh_3, surface=全頭高surface_2)  # -> out, m, s
# ---------- python: Python ----------
__author__ = "PC Mark6"
__version__ = "2021.04.16"

import rhinoscriptsyntax as rs


if preview:
    m = headMesh
    s = surface
    rs.CurrentView('Right')
# ---------- end python ----------
python_2 = GhPythonScript(preview=values_23.Values, headMesh=headmesh_2, surface=頭囲surface_2)  # -> out, m, s; same code as python
python_3 = GhPythonScript(preview=values_21.Values, headMesh=headmesh_4, surface=瞳孔間幅surface_2)  # -> out, m, s
# ---------- python_3: Python ----------
__author__ = "PC Mark6"
__version__ = "2021.04.16"

import rhinoscriptsyntax as rs


if preview:
    m = headMesh
    s = surface
    rs.CurrentView('Front')
# ---------- end python_3 ----------
python_4 = GhPythonScript(preview=values_22.Values, headMesh=headmesh_7, surface=頭幅surface_2)  # -> out, m, s; same code as python_3
python_5 = GhPythonScript(preview=values_25.Values, headMesh=headmesh_5, surface=頬骨幅surface_2)  # -> out, m, s; same code as python_3
python_6 = GhPythonScript(preview=values_26.Values, headMesh=headmesh_8, surface=乳様突起間幅surface_2)  # -> out, m, s
# ---------- python_6: Python ----------
__author__ = "PC Mark6"
__version__ = "2021.04.16"

import rhinoscriptsyntax as rs


if preview:
    m = headMesh
    s = surface
    rs.CurrentView('back')
# ---------- end python_6 ----------
python_7 = GhPythonScript(preview=values_24.Values, headMesh=headmesh_6, surface=下顎角幅surface_2)  # -> out, m, s; same code as python_3
python_8 = GhPythonScript(preview=values_27.Values, headMesh=headmesh_9, surface=耳珠間幅surface_2)  # -> out, m, s; same code as python_3
python_9 = GhPythonScript(preview=values_28.Values, headMesh=headmesh_10, surface=内眼角幅surface_2)  # -> out, m, s; same code as python_3
python_10 = GhPythonScript(preview=values_29.Values, headMesh=headmesh_11, surface=外眼角幅surface_2)  # -> out, m, s; same code as python_3
python_11 = GhPythonScript(preview=values_30.Values, headMesh=headmesh_12, surface=形態学顔高surface_2)  # -> out, m, s; same code as python
python_12 = GhPythonScript(preview=values_31.Values, headMesh=headmesh_13, surface=鼻高surface_2)  # -> out, m, s; same code as python
python_13 = GhPythonScript(preview=values_32.Values, headMesh=headmesh_14, surface=口裂幅surface_2)  # -> out, m, s; same code as python_3
python_14 = GhPythonScript(preview=values_33.Values, headMesh=headmesh_15, surface=鼻下_オトガイ距離surface_2)  # -> out, m, s; same code as python
green = RemoteSender(python.m)
red = RemoteSender(python.s)
green_2 = RemoteSender(python_3.m)
red_2 = RemoteSender(python_3.s)
green_3 = RemoteSender(python_2.m)
red_3 = RemoteSender(python_2.s)
green_4 = RemoteSender(python_4.m)
red_4 = RemoteSender(python_4.s)
green_5 = RemoteSender(python_6.m)
red_5 = RemoteSender(python_6.s)
green_6 = RemoteSender(python_8.m)
red_6 = RemoteSender(python_8.s)
green_7 = RemoteSender(python_5.m)
green_8 = RemoteSender(python_7.m)
red_7 = RemoteSender(python_7.s)
red_8 = RemoteSender(python_5.s)
green_9 = RemoteSender(python_9.m)
red_9 = RemoteSender(python_9.s)
green_10 = RemoteSender(python_10.m)
red_10 = RemoteSender(python_10.s)
green_11 = RemoteSender(python_11.m)
red_11 = RemoteSender(python_11.s)
green_12 = RemoteSender(python_12.m)
red_12 = RemoteSender(python_12.s)
green_13 = RemoteSender(python_13.m)
red_13 = RemoteSender(python_13.s)
# 基準平面から頂点までの距離
green_14 = RemoteSender(python_14.m)
red_14 = RemoteSender(python_14.s)

# ----
# Red
swatch_2 = ColourSwatch(SwatchColor=RGB(255, 0, 84))
red_15 = RemoteReceiver([red, red_2, red_3, red_4, red_8, red_7, red_6, red_5, red_9, red_10, red_13, red_11, red_12, red_14])
preview_2 = CustomPreview(Geometry=red_15, Material=swatch_2)

exposure = Exposure(Lambert=False)  # -> Exposure, Range
Y_5 = UnitY(Factor=1)
panel_36 = Panel(scale_11.Geometry)
panel_37 = Panel("1")
line_3 = LineSDL(Start="{-200, 0 ,0}", Direction=Y_5, Length=Slider(1000, range=0..1000))
lch = ColourLCH(Alpha=1, Luminance=0, Chroma=1, Hue=0.5)
merge_43 = Merge(Data1=ColourSwatch(SwatchColor=RGB(0, 255, 255)), Data2=ColourSwatch(SwatchColor=RGB(255, 255, 0)))
toggle = BooleanToggle(True)
pt_7 = ConstructPoint(XCoordinate="-200", YCoordinate=0, ZCoordinate=0)
toggle_2 = BooleanToggle(True)
toggle_3 = BooleanToggle(True)
toggle_4 = BooleanToggle(True)
toggle_5 = BooleanToggle(True)
toggle_6 = BooleanToggle(True)
pt_8 = ConstructPoint(XCoordinate=0, YCoordinate="-200", ZCoordinate=0)
pt_9 = ConstructPoint(XCoordinate=0, YCoordinate="-200", ZCoordinate=0)
pt_10 = ConstructPoint(XCoordinate=0, YCoordinate="-200", ZCoordinate=0)
pt_11 = ConstructPoint(XCoordinate=0, YCoordinate="-200", ZCoordinate=0)
toggle_7 = BooleanToggle(True)
pt_12 = ConstructPoint(XCoordinate=0, YCoordinate="-200", ZCoordinate=0)
pt_13 = ConstructPoint(XCoordinate="-200", YCoordinate=0, ZCoordinate=0)
toggle_8 = BooleanToggle(True)
toggle_9 = BooleanToggle(True)
pt_14 = ConstructPoint(XCoordinate=0, YCoordinate="-200", ZCoordinate=0)
pt_15 = ConstructPoint(XCoordinate="-200", YCoordinate=0, ZCoordinate=0)
number_slider_12 = Slider(450, range=0..1000)
panel_38 = Panel("""全頭高
瞳孔間隔
頭囲・頭長
頭幅
頬骨幅
下顎角幅
耳珠間幅
乳様突起間幅
内眼角幅
外眼角幅
口裂幅
形態学顔高
鼻高
鼻下・オトガイ距離""")
label_25 = CreateLabel(LabelText=panel_38, LabelSize=12, Justification=0)
panel_39 = Panel("""後頭・鼻尖距離,
全頭高,
瞳孔間幅,
頭囲,
頭長,
頭幅,
頬弓幅,
下顎角幅,
耳珠間幅,
乳様突起間幅,
内眼角幅,
外眼角幅,
口裂幅,
形態学顔高,
鼻高,
鼻下・オトガイ距離,""")
distance_2 = RemoteReceiver(distance)

# ---- group: copy all contentを選択
panel_40 = Panel(distance_2)

# ----
unset = RemoteSender()
item_21 = ListItem(List=label_25, Index=0, Wrap=True)  # -> Item, Item1, Item2, Item3, Item4, Item5, Item6, Item7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
merge_44 = Merge(Data1=panel_39, Data2=distance_2)
join = TextJoin(Text=merge_44)
panel_41 = Panel("""C:\Users\PC Mark6\全頭高.png
C:\Users\PC Mark6\瞳孔間幅.png
C:\Users\PC Mark6\頭囲.png
C:\Users\PC Mark6\頭幅.png
C:\Users\PC Mark6\頬弓幅.png
C:\Users\PC Mark6\下顎角幅.png
C:\Users\PC Mark6\耳珠間幅.png
C:\Users\PC Mark6\乳様突起間幅.png
C:\Users\PC Mark6\内眼角幅.png
C:\Users\PC Mark6\外眼角幅.png
C:\Users\PC Mark6\口裂幅.png
C:\Users\PC Mark6\形態学顔高.png
C:\Users\PC Mark6\鼻高.png
C:\Users\PC Mark6\鼻下・オトガイ距離.png""")
image = CreateImage(ImageSource=panel_41, ImageWidth=300)
item_22 = ListItem(List=image, Index=0, Wrap=True)  # -> Item, Item1, Item2, Item3, Item4, Item5, Item6, Item7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
merge_45 = Merge(
    Data1=item_21.Item,
    Data2=item_22.Item,
    Data3=item_21.Item1,
    Data4=item_22.Item1,
    Data5=item_21.Item2,
    Data6=item_22.Item2,
    Data7=item_21.Item3,
    Data8=item_22.Item3,
    Data9=item_21.Item4,
    Data10=item_22.Item4,
    Data11=item_21.Item5,
    Data12=item_22.Item5,
    Data13=item_21.Item6,
    Data14=item_22.Item6,
    Data15=item_21.Item7,
    Data16=item_22.Item7,
    Data17=item_21.Item8,
    Data18=item_22.Item8,
    Data19=item_21.Item9,
    Data20=item_22.Item9,
    Data21=item_21.Item10,
    Data22=item_22.Item10,
    Data23=item_21.Item11,
    Data24=item_22.Item11,
    Data25=item_21.Item12,
    Data26=item_22.Item12,
    Data27=item_21.Item13,
    Data28=item_22.Item13)

mesh_5 = RemoteReceiver(mesh_2)
merge_46 = Merge(Data1=geo)  # -> flatten(Result)
launchwin_4 = LaunchWindow(
    Show=Toggle(True),
    Name="Control Window",
    Width=Slider(500, range=0..1000),
    Height=Slider(800, range=0..1000),
    ChildStatus=0,
    EnableHorizScroll=False)
_3dview = Create3DView(MeshToDisplay=merge_46, MeshColors=RGB(255, 0, 0), ViewWidth=300, ViewHeight=300)
addelems_5 = AddElements(Window=launchwin_4, Elements=flatten(merge_45), DoVLChecking=True)  # -> AddedElements, ElementNames

winprops_4 = SetWindowProperties(Window=launchwin_4, StartingLocation="600,0", ShowTitleBar=True, ScaleFactor=1)
toggle_10 = BooleanToggle(False)
panel_42 = Panel(image)

# ----
# Green
swatch_3 = ColourSwatch(SwatchColor=RGB(14, 193, 84))
green_15 = RemoteReceiver([green, green_2, green_3, green_4, green_7, green_8, green_6, green_5, green_9, green_10, green_13, green_11, green_12, green_14])

material_2 = CreateMaterial(Diffuse=swatch_3, Specular=RGB(255, 255, 255), Emission=RGB(0, 0, 0), Transparency=Slider(0, range=0..1), Shine=0)

preview_3 = CustomPreview(Geometry=green_15, Material=material_2)

colour_swatch = ColourSwatch(SwatchColor=RGB(0, 255, 255))
conmesh = ConstructMesh(Vertices=[Point(0, 0, 0), Point(10, 0, 0), Point(10, 10, 0), Point(0, 10, 0)], Faces={A=0, B=1, C=2, D=3})

merge_47 = Merge(Data1=colour_swatch, Data2=colour_swatch, Data3=ColourSwatch(SwatchColor=RGB(255, 255, 0)))

# ---- group: 内眼角幅
_3dview_2 = Create3DView(MeshToDisplay=conmesh, MeshColors=RGB(255, 0, 0), ViewWidth=number_slider_12, ViewHeight=300)

# ----
set_3d_view = Set3DView(_3DView=_3dview_2, MeshToDisplay=scale_11.Geometry, MeshColors=merge_47)
set3dviewprops = Set3DViewProperties(
    _3DView=_3dview_2,
    ShowViewCube=toggle_3,
    AllowPan=toggle_3,
    AllowZoom=toggle_3,
    AllowMove=toggle_3,
    AllowRotation=toggle_3,
    PerspectiveParallel=toggle_3,
    CameraLocation=pt_9,
    CameraTarget="{0,0,0}",
    CameraTransitionTime="1")

conmesh_2 = ConstructMesh(Vertices=[Point(0, 0, 0), Point(10, 0, 0), Point(10, 10, 0), Point(0, 10, 0)], Faces={A=0, B=1, C=2, D=3})

# ---- group: 全頭高
_3dview_3 = Create3DView(MeshToDisplay=conmesh_2, MeshColors=RGB(255, 0, 0), ViewWidth=number_slider_12, ViewHeight=300)

# ----
set_3d_view_2 = Set3DView(_3DView=_3dview_3, MeshToDisplay=scale_10.Geometry, MeshColors=merge_47)
set3dviewprops_2 = Set3DViewProperties(
    _3DView=_3dview_3,
    ShowViewCube=toggle,
    AllowPan=toggle,
    AllowZoom=toggle,
    AllowMove=toggle,
    AllowRotation=toggle,
    PerspectiveParallel=toggle,
    CameraLocation=pt_7,
    CameraTarget="{0,0,0}",
    CameraTransitionTime="1")

conmesh_3 = ConstructMesh(Vertices=[Point(0, 0, 0), Point(10, 0, 0), Point(10, 10, 0), Point(0, 10, 0)], Faces={A=0, B=1, C=2, D=3})

# ---- group: 乳様突起間幅
_3dview_4 = Create3DView(MeshToDisplay=conmesh_3, MeshColors=RGB(255, 0, 0), ViewWidth=number_slider_12, ViewHeight=300)

# ----
set_3d_view_3 = Set3DView(_3DView=_3dview_4, MeshToDisplay=scale_15.Geometry, MeshColors=merge_47)
set3dviewprops_3 = Set3DViewProperties(
    _3DView=_3dview_4,
    ShowViewCube=toggle_7,
    AllowPan=toggle_7,
    AllowZoom=toggle_7,
    AllowMove=toggle_7,
    AllowRotation=toggle_7,
    PerspectiveParallel=toggle_7,
    CameraLocation=pt_12,
    CameraTarget="{0,0,0}",
    CameraTransitionTime="1")

conmesh_4 = ConstructMesh(Vertices=[Point(0, 0, 0), Point(10, 0, 0), Point(10, 10, 0), Point(0, 10, 0)], Faces={A=0, B=1, C=2, D=3})

# ---- group: 頭囲
_3dview_5 = Create3DView(MeshToDisplay=conmesh_4, MeshColors=RGB(255, 0, 0), ViewWidth=number_slider_12, ViewHeight=300)

# ----
set_3d_view_4 = Set3DView(_3DView=_3dview_5, MeshToDisplay=scale_3.Geometry, MeshColors=merge_43)
set3dviewprops_4 = Set3DViewProperties(
    _3DView=_3dview_5,
    ShowViewCube=toggle_6,
    AllowPan=toggle_6,
    AllowZoom=toggle_6,
    AllowMove=toggle_6,
    AllowRotation=toggle_6,
    PerspectiveParallel=toggle_6,
    CameraLocation=pt_13,
    CameraTarget="{0, 0, 0}",
    CameraTransitionTime="1")

conmesh_5 = ConstructMesh(Vertices=[Point(0, 0, 0), Point(10, 0, 0), Point(10, 10, 0), Point(0, 10, 0)], Faces={A=0, B=1, C=2, D=3})

# ---- group: 口裂幅
_3dview_6 = Create3DView(MeshToDisplay=conmesh_5, MeshColors=RGB(255, 0, 0), ViewWidth=number_slider_12, ViewHeight=300)

# ----
set_3d_view_5 = Set3DView(_3DView=_3dview_6, MeshToDisplay=scale_9.Geometry, MeshColors=merge_47)
set3dviewprops_5 = Set3DViewProperties(
    _3DView=_3dview_6,
    ShowViewCube=toggle_2,
    AllowPan=toggle_2,
    AllowZoom=toggle_2,
    AllowMove=toggle_2,
    AllowRotation=toggle_2,
    PerspectiveParallel=toggle_2,
    CameraLocation=pt_11,
    CameraTarget="{0,0,0}",
    CameraTransitionTime="1")

conmesh_6 = ConstructMesh(Vertices=[Point(0, 0, 0), Point(10, 0, 0), Point(10, 10, 0), Point(0, 10, 0)], Faces={A=0, B=1, C=2, D=3})

# ---- group: 頭幅
_3dview_7 = Create3DView(MeshToDisplay=conmesh_6, MeshColors=RGB(255, 0, 0), ViewWidth=number_slider_12, ViewHeight=300)

# ----
set_3d_view_6 = Set3DView(_3DView=_3dview_7, MeshToDisplay=scale_6.Geometry, MeshColors=merge_47)
set3dviewprops_6 = Set3DViewProperties(
    _3DView=_3dview_7,
    ShowViewCube=toggle_5,
    AllowPan=toggle_5,
    AllowZoom=toggle_5,
    AllowMove=toggle_5,
    AllowRotation=toggle_5,
    PerspectiveParallel=toggle_5,
    CameraLocation=pt_10,
    CameraTarget="{0,0,0}",
    CameraTransitionTime="1")

conmesh_7 = ConstructMesh(Vertices=[Point(0, 0, 0), Point(10, 0, 0), Point(10, 10, 0), Point(0, 10, 0)], Faces={A=0, B=1, C=2, D=3})

# ---- group: 耳珠間幅
_3dview_8 = Create3DView(MeshToDisplay=conmesh_7, MeshColors=RGB(255, 0, 0), ViewWidth=number_slider_12, ViewHeight=300)

# ----
set_3d_view_7 = Set3DView(_3DView=_3dview_8, MeshToDisplay=scale_12.Geometry, MeshColors=merge_47)
set3dviewprops_7 = Set3DViewProperties(
    _3DView=_3dview_8,
    ShowViewCube=toggle_4,
    AllowPan=toggle_4,
    AllowZoom=toggle_4,
    AllowMove=toggle_4,
    AllowRotation=toggle_4,
    PerspectiveParallel=toggle_4,
    CameraLocation=pt_8,
    CameraTarget="{0,0,0}",
    CameraTransitionTime="1")

conmesh_8 = ConstructMesh(Vertices=[Point(0, 0, 0), Point(10, 0, 0), Point(10, 10, 0), Point(0, 10, 0)], Faces={A=0, B=1, C=2, D=3})

# ---- group: 外眼角幅
_3dview_9 = Create3DView(MeshToDisplay=conmesh_8, MeshColors=RGB(255, 0, 0), ViewWidth=number_slider_12, ViewHeight=300)

# ----
set_3d_view_8 = Set3DView(_3DView=_3dview_9, MeshToDisplay=scale_2.Geometry, MeshColors=merge_47)
set3dviewprops_8 = Set3DViewProperties(
    _3DView=_3dview_9,
    ShowViewCube=toggle_8,
    AllowPan=toggle_8,
    AllowZoom=toggle_8,
    AllowMove=toggle_8,
    AllowRotation=toggle_8,
    PerspectiveParallel=toggle_8,
    CameraLocation=pt_14,
    CameraTarget="{0,0,0}",
    CameraTransitionTime="1")

conmesh_9 = ConstructMesh(Vertices=[Point(0, 0, 0), Point(10, 0, 0), Point(10, 10, 0), Point(0, 10, 0)], Faces={A=0, B=1, C=2, D=3})

# ---- group: 鼻高
_3dview_10 = Create3DView(MeshToDisplay=conmesh_9, MeshColors=RGB(255, 0, 0), ViewWidth=number_slider_12, ViewHeight=300)

# ----
set_3d_view_9 = Set3DView(_3DView=_3dview_10, MeshToDisplay=scale_13.Geometry, MeshColors=merge_47)
set3dviewprops_9 = Set3DViewProperties(
    _3DView=_3dview_10,
    ShowViewCube=toggle_9,
    AllowPan=toggle_9,
    AllowZoom=toggle_9,
    AllowMove=toggle_9,
    AllowRotation=toggle_9,
    PerspectiveParallel=toggle_9,
    CameraLocation=pt_15,
    CameraTarget="{0,0,0}",
    CameraTransitionTime="1")

conmesh_10 = ConstructMesh(Vertices=[Point(0, 0, 0), Point(10, 0, 0), Point(10, 10, 0), Point(0, 10, 0)], Faces={A=0, B=1, C=2, D=3})
toggle_11 = BooleanToggle(True)
pt_16 = ConstructPoint(XCoordinate=0, YCoordinate="-200", ZCoordinate=0)

# ---- group: 瞳孔間幅
_3dview_11 = Create3DView(MeshToDisplay=conmesh_10, MeshColors=RGB(255, 0, 0), ViewWidth=number_slider_12, ViewHeight=300)

# ----
set_3d_view_10 = Set3DView(_3DView=_3dview_11, MeshToDisplay=scale.Geometry, MeshColors=merge_47)
set3dviewprops_10 = Set3DViewProperties(
    _3DView=_3dview_11,
    ShowViewCube=toggle_11,
    AllowPan=toggle_11,
    AllowZoom=toggle_11,
    AllowMove=toggle_11,
    AllowRotation=toggle_11,
    PerspectiveParallel=toggle_11,
    CameraLocation=pt_16,
    CameraTarget="{0,0,0}",
    CameraTransitionTime="1")

conmesh_11 = ConstructMesh(Vertices=[Point(0, 0, 0), Point(10, 0, 0), Point(10, 10, 0), Point(0, 10, 0)], Faces={A=0, B=1, C=2, D=3})
toggle_12 = BooleanToggle(True)
pt_17 = ConstructPoint(XCoordinate=0, YCoordinate="-200", ZCoordinate=0)

# ---- group: 形態学顔高
_3dview_12 = Create3DView(MeshToDisplay=conmesh_11, MeshColors=RGB(255, 0, 0), ViewWidth=number_slider_12, ViewHeight=300)

# ----
set_3d_view_11 = Set3DView(_3DView=_3dview_12, MeshToDisplay=scale_5.Geometry, MeshColors=merge_47)
set3dviewprops_11 = Set3DViewProperties(
    _3DView=_3dview_12,
    ShowViewCube=toggle_12,
    AllowPan=toggle_12,
    AllowZoom=toggle_12,
    AllowMove=toggle_12,
    AllowRotation=toggle_12,
    PerspectiveParallel=toggle_12,
    CameraLocation=pt_17,
    CameraTarget="{0,0,0}",
    CameraTransitionTime="1")

conmesh_12 = ConstructMesh(Vertices=[Point(0, 0, 0), Point(10, 0, 0), Point(10, 10, 0), Point(0, 10, 0)], Faces={A=0, B=1, C=2, D=3})
toggle_13 = BooleanToggle(True)
pt_18 = ConstructPoint(XCoordinate=0, YCoordinate="-500", ZCoordinate=0)

# ---- group: 頬弓幅
_3dview_13 = Create3DView(MeshToDisplay=conmesh_12, MeshColors=RGB(255, 0, 0), ViewWidth=number_slider_12, ViewHeight=300)

# ----
set_3d_view_12 = Set3DView(_3DView=_3dview_13, MeshToDisplay=scale_8.Geometry, MeshColors=merge_47)
set3dviewprops_12 = Set3DViewProperties(
    _3DView=_3dview_13,
    ShowViewCube=toggle_13,
    AllowPan=toggle_13,
    AllowZoom=toggle_13,
    AllowMove=toggle_13,
    AllowRotation=toggle_13,
    PerspectiveParallel=toggle_13,
    CameraLocation=pt_18,
    CameraTarget="{0,0,0}",
    CameraTransitionTime="1")

conmesh_13 = ConstructMesh(Vertices=[Point(0, 0, 0), Point(10, 0, 0), Point(10, 10, 0), Point(0, 10, 0)], Faces={A=0, B=1, C=2, D=3})
toggle_14 = BooleanToggle(True)
pt_19 = ConstructPoint(XCoordinate=0, YCoordinate="-200", ZCoordinate=0)

# ---- group: 下顎角幅
_3dview_14 = Create3DView(MeshToDisplay=conmesh_13, MeshColors=RGB(255, 0, 0), ViewWidth=number_slider_12, ViewHeight=300)

# ----
set_3d_view_13 = Set3DView(_3DView=_3dview_14, MeshToDisplay=merge_34, MeshColors=merge_47)
set3dviewprops_13 = Set3DViewProperties(
    _3DView=_3dview_14,
    ShowViewCube=toggle_14,
    AllowPan=toggle_14,
    AllowZoom=toggle_14,
    AllowMove=toggle_14,
    AllowRotation=toggle_14,
    PerspectiveParallel=toggle_14,
    CameraLocation=pt_19,
    CameraTarget="{0,0,0}",
    CameraTransitionTime="1")

conmesh_14 = ConstructMesh(Vertices=[Point(0, 0, 0), Point(10, 0, 0), Point(10, 10, 0), Point(0, 10, 0)], Faces={A=0, B=1, C=2, D=3})
toggle_15 = BooleanToggle(True)
pt_20 = ConstructPoint(XCoordinate="-200", YCoordinate=0, ZCoordinate=0)

# ---- group: 鼻下・オトガイ距離
_3dview_15 = Create3DView(MeshToDisplay=conmesh_14, MeshColors=RGB(255, 0, 0), ViewWidth=number_slider_12, ViewHeight=300)

# ----
set_3d_view_14 = Set3DView(_3DView=_3dview_15, MeshToDisplay=scale_14.Geometry, MeshColors=merge_47)
set3dviewprops_14 = Set3DViewProperties(
    _3DView=_3dview_15,
    ShowViewCube=toggle_15,
    AllowPan=toggle_15,
    AllowZoom=toggle_15,
    AllowMove=toggle_15,
    AllowRotation=toggle_15,
    PerspectiveParallel=toggle_15,
    CameraLocation=pt_20,
    CameraTarget="{0,0,0}",
    CameraTransitionTime="1")
